# Grasshopper definition CalculateLinesAndPoints.gh (Grasshopper 0.9.76)

to_edge_right_of_blind_spot_center_y_neg = Line(Line((0, 0, 2094.69159), (0, -2338.082087, 2094.69159)))  # "To Edge Right of Blind Spot Center, y negative"
to_edge_above_blind_spot_center_y_negati = Line(Line((0, 0, 2094.69159), (0, 0, 3221.072803)))  # "To Edge Above Blind Spot Center, y negative"
to_edge_left_of_blind_spot_center_y_posi = Line(Line((0, 0, 2094.69159), (0, 2619.587517, 2094.69159)))  # "To Edge Left of Blind Spot Center, y positive"
y_dimension_to_blindspot_center = Line(Line((0, 0, 0), (0, 0, 2094.69159)))
pt = Point(<point referenced from the Rhino model>)
pdecon = Deconstruct(Point=pt)  # -> XComponent, YComponent, ZComponent
len = Length(Curve=y_dimension_to_blindspot_center)
len_2 = Length(Curve=to_edge_left_of_blind_spot_center_y_posi)
len_3 = Length(Curve=to_edge_above_blind_spot_center_y_negati)
len_4 = Length(Curve=to_edge_right_of_blind_spot_center_y_neg)
panel = Panel(len)
panel_2 = Panel(len_2)
panel_3 = Panel(len_3)
panel_4 = Panel(len_4)
panel_5 = Panel(pdecon.XComponent)
panel_6 = Panel(pdecon.ZComponent)
panel_7 = Panel(pdecon.YComponent)
