# Grasshopper definition GyroscopePointRotation.gh (Grasshopper 0.9.76)

number_slider = Slider(939, range=0..1000)
origin = Point(<point referenced from the Rhino model>)

X = UnitX(Factor=number_slider)
Z = UnitZ(Factor=number_slider)
Y = UnitY(Factor=number_slider)
move = Move(Geometry=origin, Motion=X)  # -> Geometry, Transform
move_2 = Move(Geometry=origin, Motion=Y)  # -> Geometry, Transform
pl_3pt = Plane3Pt(PointA=origin, PointB=move.Geometry, PointC=move_2.Geometry)
cir = Circle(Plane=pl_3pt, Radius=number_slider)

# ----
# Rotation around Z Axis
curvepoint = PointOnCurve(cir, parameter=0)
Z_2 = UnitZ(Factor=number_slider)
x_dir_pt = Point(curvepoint)
move_3 = Move(Geometry=curvepoint, Motion=Z_2)  # -> Geometry, Transform
pl_3pt_2 = Plane3Pt(PointA=origin, PointB=x_dir_pt, PointC=move_3.Geometry)
cir_2 = Circle(Plane=pl_3pt_2, Radius=number_slider)

# ----
# Rotation around Y Axis
curvepoint_2 = PointOnCurve(cir_2, parameter=0)
Y_2 = UnitY(Factor=number_slider)
move_4 = Move(Geometry=curvepoint_2, Motion=Y_2)  # -> Geometry, Transform
pl_3pt_3 = Plane3Pt(PointA=origin, PointB=curvepoint_2, PointC=move_4.Geometry)
cir_3 = Circle(Plane=pl_3pt_3, Radius=number_slider)

pt = Point(<point referenced from the Rhino model>)
divide = DivideCurve(Curve=cir, Count=Slider(360, range=0..1000), Kinks=False)  # -> Points, Tangents, Parameters
Z_3 = UnitZ(Factor=number_slider)
move_5 = Move(Geometry=curvepoint, Motion=Z_3)  # -> Geometry, Transform
item = ListItem(List=divide.Points, Index=Slider(0, range=0..360), Wrap=True)
pl_3pt_4 = Plane3Pt(PointA=origin, PointB=x_dir_pt, PointC=move_3.Geometry)
cir_4 = Circle(Plane=pl_3pt_4, Radius=number_slider)
